# Dynamo graph CurveLibraryTest.dyn (Dynamo 2.3.2.15696)

list_create = List.Create()  # unwired: item0, item1
select_model_elements = DSModelElementsSelection()  # 6 picked in the model
code_block = CodeBlock(a=select_model_elements) { List.Flatten(a.Curves); }
type = Object.Type(obj=code_block)
code_block_2 = CodeBlock(str=type) { String.Contains(str,"Line")?2:3; }
code_block_3 = CodeBlock(num=code_block_2) { 0..1..#num; 0..1..#3; }
pointAtParameter = Curve.PointAtParameter(curve=code_block, param=code_block_3.out0)
code_block_4 = CodeBlock(a=pointAtParameter) { a.X; a.Y; }
combine = List.Combine(comb=list_create, list1=code_block_4.out0, list2=code_block_4.out1)
transpose = List.Transpose(lists=combine@L3)
python_script = Python(IN[0]=transpose)
# ---------- python_script.python (27 lines) ----------
# Load the Python Standard and DesignScript Libraries
import sys
import clr
clr.AddReference('ProtoGeometry')
from Autodesk.DesignScript.Geometry import *
sys.path.append('C:\Users\dlagu\OneDrive\Documents\GitHub\DY-Dynamo\script\Python\Align.extension\lib')
import CurveProcessor as CP

# The inputs to this node will be stored as a list in the IN variables.
dataEnteringNode = IN
data = IN[0]
translated = []
for i in IN[0]:
	if len(i) == 2:
		pt1 = CP.PointEntity(i[0][0], i[0][1])
		pt2 = CP.PointEntity(i[1][0], i[1][1])
		translated.append(CP.LineEntity(pt1, pt2))
	else:
		create = CP.CreateEntity()
		pt1 = CP.PointEntity(i[0][0], i[0][1])
		pt2 = CP.PointEntity(i[1][0], i[1][1])
		pt3 = CP.PointEntity(i[2][0], i[2][1])
		translated.append(create.ArcByThreePoints(pt1, pt3, pt2))
# Place your code below this line
poly = CP.PolyCurveEntity(translated)
# Assign your output to the OUT variable.
OUT = translated, poly.IsContinuous(translated)
# ----------------------------------------
join = List.Join()  # unwired: list0, list1
